# Grasshopper definition Write-gcode-ver3-Desktop.ghx (Grasshopper 0.9.76)
# plug-ins: Python Interpreter, GH_CPython

# ---- group: W
number_slider = Slider(4, range=0..100)

number_slider_2 = Slider(4, range=0..100)

number_slider_3 = Slider(20, range=0..100)

# ----
number_slider_4 = Slider(40, range=0..1000)
number_slider_5 = Slider(150, range=0..1000)

# ---- group: Margin
number_slider_6 = Slider(25, range=1..200)

# ---- group: size
panel = Panel("500")

# ---- group: Margin
number_slider_7 = Slider(10, range=1..200)

# ---- group: size
panel_2 = Panel("100")

# ---- group: Margin
number_slider_8 = Slider(25, range=1..200)

# ---- group: layer_count
number_slider_9 = Slider(10, range=1..350)

# ---- group: size
panel_3 = Panel("500")

# ---- group: layer_count
number_slider_10 = Slider(175, range=1..350)

# ---- group: layer_height
number_slider_11 = Slider(1.5, range=0.1..30)

# ----
rectangle = Rectangle(Plane=PlaneXY(0, 0, 0), XSize="0 to 800", YSize="0 to 800", Radius=0)  # -> Rectangle, Length
crv = Curve(rectangle.Rectangle)

rectangle_2 = Rectangle(Plane=PlaneXY(0, 0, 0), XSize="200 to 600", YSize="200 to 600", Radius=0)  # -> Rectangle, Length
crv_2 = Curve(rectangle_2.Rectangle)

# ---- group: layer_height
number_slider_12 = Slider(0.2, range=0.1..30)

number_slider_13 = Slider(1.5, range=0.1..30)

# ----
multiplication = Multiplication(A=number_slider_9, B=number_slider_12)
multiplication_2 = Multiplication(A=number_slider_10, B=number_slider_13)
multiplication_3 = Multiplication(A=multiplication, B="2")
multiplication_4 = Multiplication(A=multiplication_2, B="2")
neg = Negative(Value=number_slider_6)
division = Division(A="65", B=number_slider)
addition = Addition(A=panel, B=number_slider_6)
division_2 = Division(A=panel_2, B=number_slider_2)
addition_2 = Addition(A=panel_2, B=number_slider_7)
division_3 = Division(A=panel_3, B=number_slider_3)
addition_3 = Addition(A=panel_3, B=number_slider_8)
Y = UnitY(Factor=neg)
pt = ConstructPoint(XCoordinate=Slider(40, range=0..1000), YCoordinate=Slider(150, range=0..1000), ZCoordinate=0)
addition_4 = Addition(A=addition, B=number_slider_6)
pt_2 = ConstructPoint(XCoordinate=number_slider_4, YCoordinate=number_slider_4, ZCoordinate=0)
pt_3 = ConstructPoint(XCoordinate=number_slider_5, YCoordinate=number_slider_5, ZCoordinate=0)
neg_2 = Negative(Value=number_slider_7)

# ---- group: Printing Height
panel_4 = Panel(multiplication_3)

# ----
neg_3 = Negative(Value=number_slider_8)

# ---- group: Printing Height
panel_5 = Panel(multiplication_4)

# ----
addition_5 = Addition(A=addition_2, B=number_slider_7)
addition_6 = Addition(A=addition_3, B=number_slider_8)
neg_4 = Negative(Value=addition_4)
neg_5 = Negative(Value=addition_5)
Y_2 = UnitY(Factor=neg_2)
Y_3 = UnitY(Factor=addition)
X = UnitX(Factor=number_slider)
neg_6 = Negative(Value=addition_6)
Y_4 = UnitY(Factor=neg_3)
Y_5 = UnitY(Factor=addition_2)
X_2 = UnitX(Factor=number_slider_2)
Y_6 = UnitY(Factor=addition_3)
X_3 = UnitX(Factor=number_slider_3)
Y_7 = UnitY(Factor=neg_4)
Y_8 = UnitY(Factor=neg_5)
Y_9 = UnitY(Factor=neg_6)
move = Move(Geometry=pt, Motion=Y)  # -> Geometry, Transform
move_2 = Move(Geometry=pt_2, Motion=Y_2)  # -> Geometry, Transform
move_3 = Move(Geometry=pt, Motion=Y_3)  # -> Geometry, Transform
move_4 = Move(Geometry=move_3.Geometry, Motion=X)  # -> Geometry, Transform
move_5 = Move(Geometry=move_4.Geometry, Motion=Y_7)  # -> Geometry, Transform
move_6 = Move(Geometry=move_5.Geometry, Motion=X)  # -> Geometry, Transform
move_7 = Move(Geometry=pt_3, Motion=Y_4)  # -> Geometry, Transform
preview = CustomPreview(Geometry=crv, Shader=ColourSwatch(SwatchColor=RGB(255, 255, 255)))

rectangle_3 = Rectangle(Plane=PlaneXY(0, 0, 0), XSize="0 to 200", YSize="0 to 200", Radius=0)  # -> Rectangle, Length
crv_3 = Curve(rectangle_3.Rectangle)

rectangle_4 = Rectangle(Plane=PlaneXY(0, 0, 0), XSize="200 to 600", YSize="200 to 600", Radius=0)  # -> Rectangle, Length
crv_4 = Curve(rectangle_4.Rectangle)

move_8 = Move(Geometry=pt_2, Motion=Y_5)  # -> Geometry, Transform
move_9 = Move(Geometry=move_8.Geometry, Motion=X_2)  # -> Geometry, Transform
move_10 = Move(Geometry=move_9.Geometry, Motion=Y_8)  # -> Geometry, Transform
move_11 = Move(Geometry=move_10.Geometry, Motion=X_2)  # -> Geometry, Transform
move_12 = Move(Geometry=pt_3, Motion=Y_6)  # -> Geometry, Transform
move_13 = Move(Geometry=move_12.Geometry, Motion=X_3)  # -> Geometry, Transform
move_14 = Move(Geometry=move_13.Geometry, Motion=Y_9)  # -> Geometry, Transform
move_15 = Move(Geometry=move_14.Geometry, Motion=X_3)  # -> Geometry, Transform
integer_division = IntegerDivision(A=division, B="2")
integer_division_2 = IntegerDivision(A=division_2, B="2")
integer_division_3 = IntegerDivision(A=division_3, B="2")
merge = Merge(Data1=move.Geometry, Data2=move_3.Geometry, Data3=move_4.Geometry, Data4=move_5.Geometry, Data5=move_6.Geometry)
multiplication_5 = Multiplication(A=number_slider, B="2")
multiplication_6 = Multiplication(A=number_slider_2, B="2")
multiplication_7 = Multiplication(A=number_slider_3, B="2")
merge_2 = Merge(Data1=move_2.Geometry, Data2=move_8.Geometry, Data3=move_9.Geometry, Data4=move_10.Geometry, Data5=move_11.Geometry)
merge_3 = Merge(Data1=move_7.Geometry, Data2=move_12.Geometry, Data3=move_13.Geometry, Data4=move_14.Geometry, Data5=move_15.Geometry)
series = Series(Start=0, Step=multiplication_5, Count=integer_division)
pline = PolyLine(Vertices=merge, Closed=False)
series_2 = Series(Start=0, Step=multiplication_6, Count=integer_division_2)
series_3 = Series(Start=0, Step=multiplication_7, Count=integer_division_3)
pline_2 = PolyLine(Vertices=merge_2, Closed=False)
pline_3 = PolyLine(Vertices=merge_3, Closed=False)
X_4 = UnitX(Factor=series)
X_5 = UnitX(Factor=series_2)
X_6 = UnitX(Factor=series_3)
move_16 = Move(Geometry=pline, Motion=X_4)  # -> Geometry, Transform
move_17 = Move(Geometry=pline_2, Motion=X_5)  # -> Geometry, Transform
move_18 = Move(Geometry=pline_3, Motion=X_6)  # -> Geometry, Transform
join = JoinCurves(Curves=move_16.Geometry, Preserve=False)
join_2 = JoinCurves(Curves=move_17.Geometry, Preserve=False)
join_3 = JoinCurves(Curves=move_18.Geometry, Preserve=False)
preview_2 = CustomPreview(Geometry=crv_3, Shader=ColourSwatch(SwatchColor=RGB(255, 255, 255)))
bbox = BoundingBox(Content=join_2, Plane=PlaneXY(0, 0, 0))  # -> Box, Box_2
bbox_2 = BoundingBox(Content=join_3, Plane=PlaneXY(0, 0, 0))  # -> Box, Box_2
area = Area(Geometry=bbox.Box_2)  # -> Area, Centroid
area_2 = Area(Geometry=bbox_2.Box_2)  # -> Area, Centroid
pdecon = Deconstruct(Point=area.Centroid)  # -> XComponent, YComponent, ZComponent
pdecon_2 = Deconstruct(Point=area_2.Centroid)  # -> XComponent, YComponent, ZComponent
pt_4 = ConstructPoint(XCoordinate=pdecon.XComponent, YCoordinate=pdecon.YComponent, ZCoordinate=0)
pt_5 = ConstructPoint(XCoordinate=pdecon_2.XComponent, YCoordinate=pdecon_2.YComponent, ZCoordinate=0)
rotate = Rotate(Geometry=join_2, Angle="0.5 * pi", Plane=pt_4)  # -> Geometry, Transform
rotate_2 = Rotate(Geometry=join_3, Angle="0.5 * pi", Plane=pt_5)  # -> Geometry, Transform
merge_4 = Merge(Data1=join, Data2=join_3, Data3=rotate_2.Geometry)  # -> flatten(Result)
crv_5 = Curve(rotate.Geometry)
crv_6 = Curve(rotate_2.Geometry)
crv_7 = Curve(join_2)
crv_8 = Curve(join_3)
crv_9 = Curve(merge_4)
multiplication_8 = Multiplication(A=number_slider_12, B="2")
multiplication_9 = Multiplication(A=number_slider_13, B="2")
series_4 = Series(Start=multiplication_8, Step=multiplication_8, Count=number_slider_9)
series_5 = Series(Start=multiplication_9, Step=multiplication_9, Count=number_slider_10)
series_6 = Series(Start=number_slider_12, Step=multiplication_8, Count=number_slider_9)
series_7 = Series(Start=number_slider_13, Step=multiplication_9, Count=number_slider_10)
viewer = ParamViewer(series_6)
viewer_2 = ParamViewer(series_7)
panel_6 = Panel(series_6)
panel_7 = Panel(series_7)
Z = UnitZ(Factor=series_6)
Z_2 = UnitZ(Factor=series_4)
Z_3 = UnitZ(Factor=series_7)
Z_4 = UnitZ(Factor=series_5)
move_19 = Move(Geometry=crv_7, Motion=Z)  # -> Geometry, Transform
move_20 = Move(Geometry=crv_5, Motion=Z_2)  # -> Geometry, Transform
move_21 = Move(Geometry=crv_8, Motion=Z_3)  # -> Geometry, Transform
move_22 = Move(Geometry=crv_6, Motion=Z_4)  # -> Geometry, Transform
disc = Discontinuity(Curve=join, Level=1)  # -> Points, Parameters
disc_2 = Discontinuity(Curve=crv_7, Level=1)  # -> Points, Parameters
shatter = Shatter(Curve=join, Parameters=disc.Parameters)
disc_3 = Discontinuity(Curve=crv_8, Level=1)  # -> Points, Parameters
shatter_2 = Shatter(Curve=crv_7, Parameters=disc_2.Parameters)
disc_4 = Discontinuity(Curve=crv_5, Level=1)  # -> Points, Parameters
shatter_3 = Shatter(Curve=crv_5, Parameters=disc_4.Parameters)
shatter_4 = Shatter(Curve=crv_8, Parameters=disc_3.Parameters)
disc_5 = Discontinuity(Curve=crv_6, Level=1)  # -> Points, Parameters
shatter_5 = Shatter(Curve=crv_6, Parameters=disc_5.Parameters)
len = Length(Curve=shatter)
len_2 = Length(Curve=shatter_2)
len_3 = Length(Curve=shatter_4)
len_4 = Length(Curve=shatter_3)
len_5 = Length(Curve=shatter_5)
pdecon_3 = Deconstruct(Point=disc.Points)  # -> XComponent, YComponent, ZComponent
lng = ListLength(List=len_2)
lng_2 = ListLength(List=len_3)
pdecon_4 = Deconstruct(Point=disc_2.Points)  # -> XComponent, YComponent, ZComponent
pdecon_5 = Deconstruct(Point=disc_4.Points)  # -> XComponent, YComponent, ZComponent
pdecon_6 = Deconstruct(Point=disc_3.Points)  # -> XComponent, YComponent, ZComponent
pdecon_7 = Deconstruct(Point=disc_5.Points)  # -> XComponent, YComponent, ZComponent
panel_8 = Panel(pdecon_4.ZComponent)
panel_9 = Panel(pdecon_6.ZComponent)
panel_10 = Panel(lng)
lng_3 = ListLength(List=len_4)
panel_11 = Panel(lng_2)
lng_4 = ListLength(List=len_5)
lng_5 = ListLength(List=pdecon_3.XComponent)
panel_12 = Panel(lng_3)
lng_6 = ListLength(List=pdecon_4.XComponent)
lng_7 = ListLength(List=pdecon_5.XComponent)
panel_13 = Panel(lng_4)
lng_8 = ListLength(List=pdecon_6.XComponent)
lng_9 = ListLength(List=pdecon_7.XComponent)
ins = InsertItems(List=len, Item="0", Indices="0", Wrap=True)
ins_2 = InsertItems(List=len_2, Item="0", Indices="0", Wrap=True)
ins_3 = InsertItems(List=len_3, Item="0", Indices="0", Wrap=True)
panel_14 = Panel(lng_6)
panel_15 = Panel(lng_8)
ins_4 = InsertItems(List=len_4, Item="0", Indices="0", Wrap=True)
ins_5 = InsertItems(List=len_5, Item="0", Indices="0", Wrap=True)
panel_16 = Panel(ins_4)
panel_17 = Panel(ins_5)
panel_18 = Panel(ins_2)
panel_19 = Panel(ins_3)
number_slider_14 = Slider(0.1, range=0..1)
number_slider_15 = Slider(5, range=0..10)
panel_20 = Panel(ins)
multiplication_10 = Multiplication(A=ins, B=Slider(5, range=0..10))
multiplication_11 = Multiplication(A=ins_2, B=number_slider_14)
multiplication_12 = Multiplication(A=ins_4, B=number_slider_14)
multiplication_13 = Multiplication(A=ins_3, B=number_slider_15)
multiplication_14 = Multiplication(A=ins_5, B=number_slider_15)
python = PythonScript(x=series_6)  # -> out, a; inputs x: list
# ---------- python: Python ----------
num = x

# print(num)

#len = len(num)
#len = len(x)

print(len)

print("---")

for i in xrange(len):
    print(i)
    
    print(num[i])
# ---------- end python ----------
python_2 = PythonScript(x=series_7)  # -> out, a; inputs x: list; same code as python
python_3 = PythonScript(
    layer_count=number_slider_9,
    a_len=lng_6,
    a_x=pdecon_4.XComponent,
    a_y=pdecon_4.YComponent,
    a_z=series_6,
    a_e=multiplication_11,
    b_len=lng_7,
    b_x=pdecon_5.XComponent,
    b_y=pdecon_5.YComponent,
    b_z=series_4,
    b_e=multiplication_12)  # -> out, gcode; inputs layer_count: Int32, a_x: list, a_y: list, a_z: list, a_e: list, b_x: list, b_y: list, b_z: list, b_e: list
# ---------- python_3: Python ----------
gcode = []

z = 0
EA = 0
EB = 0

gcode.append("; Body") #F
gcode.append("G1 Z30" + " F1000") #F

for j in range(layer_count):
    
    # z += layer_height
    print(str(a_z[j]))

    
    for i in range(a_len):
        EA += float(a_e[i])
        delta_EA = float(a_e[i])
        a_test = "G1 X" + str(a_x[i]) + " Y" + str(a_y[i]) + " Z" + str(a_z[j]) + " E" + str(EA) + " ;delta_E " + str(delta_EA)
        gcode.append(a_test)


    EA = 0    
    gcode.append("G92 E0")

    
    
    # z += layer_height



    for i in range(b_len):
        EB += float(b_e[i])
        delta_EB = float(b_e[i])
        b_test = "G1 X" + str(b_x[i]) + " Y" + str(b_y[i]) + " Z" + str(b_z[j]) + " E" + str(EB) + " ;delta_E " + str(delta_EB)
        gcode.append(b_test)
    
    EB = 0
    gcode.append("G92 E0")
# ---------- end python_3 ----------
python_4 = PythonScript(
    layer_count=number_slider_10,
    a_len=lng_8,
    a_x=pdecon_6.XComponent,
    a_y=pdecon_6.YComponent,
    a_z=series_7,
    a_e=multiplication_13,
    b_len=lng_9,
    b_x=pdecon_7.XComponent,
    b_y=pdecon_7.YComponent,
    b_z=series_5,
    b_e=multiplication_14)  # -> out, gcode; inputs layer_count: Int32, a_x: list, a_y: list, a_z: list, a_e: list, b_x: list, b_y: list, b_z: list, b_e: list
# ---------- python_4: Python ----------
gcode = []

z = 0
EA = 0
EB = 0

gcode.append("; Body") #F
gcode.append("G1 Z30" + " F4000") #F

for j in range(layer_count):
    
    # z += layer_height
    print(str(a_z[j]))

    
    for i in range(a_len):
        EA += float(a_e[i])
        delta_EA = float(a_e[i])
        a_test = "G1 X" + str(a_x[i]) + " Y" + str(a_y[i]) + " Z" + str(a_z[j]) + " E" + str(EA) + " ;delta_E " + str(delta_EA)
        gcode.append(a_test)


    EA = 0    
    gcode.append("G92 E0")

    
    
    # z += layer_height



    for i in range(b_len):
        EB += float(b_e[i])
        delta_EB = float(b_e[i])
        b_test = "G1 X" + str(b_x[i]) + " Y" + str(b_y[i]) + " Z" + str(b_z[j]) + " E" + str(EB) + " ;delta_E " + str(delta_EB)
        gcode.append(b_test)
    
    EB = 0
    gcode.append("G92 E0")
# ---------- end python_4 ----------
skirt = GH_CPython(layer_height=number_slider_11, a_len=lng_5, a_x=pdecon_3.XComponent, a_y=pdecon_3.ZComponent, a_e=multiplication_10)  # -> gcode; inputs layer_height: list, a_len: list, a_x: list, a_y: list, a_e: list
#   port a_len: [required] - [type = int] - [default = None] Descripe your input here * bullet point. * bullet point
# ---------- skirt: Python ----------
gcode = []

EA = 0

gcode.append("; Skirt")


z = layer_height
gcode.append("G1 Z" + str(z) + " F4000")


for i in xrange(a_len):
    EA += float(a_e[i])
    delta_EA = float(a_e[i])
    a_test = "G1 X" + str(a_x[i]) + " Y" + str(a_y[i]) + " E" + str(EA) + " ;delta_E " + str(delta_EA)
    gcode.append(a_test)

EA = 0    
gcode.append("G92 E0")




len = len(gcode)

for i in xrange(len):
    print(gcode[i])
# ---------- end skirt ----------
python_5 = PythonScript(layer_height=number_slider_11, a_len=lng_5, a_x=pdecon_3.XComponent, a_y=pdecon_3.YComponent, a_e=multiplication_10)  # -> out, gcode; inputs a_x: list, a_y: list, a_e: list
# ---------- python_5: Python ----------
gcode = []

EA = 0

gcode.append("; Skirt") #F


z = layer_height
gcode.append("G1 Z" + str(z) + " F4000") #F

for i in range(a_len):
    EA += float(a_e[i])
    delta_EA = float(a_e[i])
    a_test = "G1 X" + str(a_x[i]) + " Y" + str(a_y[i]) + " E" + str(EA) + " ;delta_E " + str(delta_EA)
    gcode.append(a_test)

EA = 0    
gcode.append("G92 E0")
# ---------- end python_5 ----------
python_6 = PythonScript()  # -> out, a
# ---------- python_6: Python ----------
a = []

a.append("hello")

text = "teeeext"
a.append(text)
# ---------- end python_6 ----------
panel_23 = Panel(python.out)
gh_cpython = GH_CPython()  # -> a
#   port a: indicate your output description here. refers to a new line.
# ---------- gh_cpython: Python ----------
a = []

a.append("hello")

text = "teeeext"
a.append(text)

for i in xrange(2):
    print(a[i])


print("---")

for i in xrange(len(a)):
    print(i)
    print(a[i])

print("---")


print(a)
# ---------- end gh_cpython ----------
panel_24 = Panel(python_2.out)
panel_25 = Panel(gh_cpython)
panel_26 = Panel(python_6.a)
panel_27 = Panel(python_3.out)
panel_28 = Panel(python_4.out)
panel_29 = Panel(python_3.gcode)
panel_30 = Panel(python_4.gcode)
panel_31 = Panel(python_5.gcode)
panel_32 = Panel(skirt)
txt = Text(python_5.gcode)
txt_2 = Text(python_4.gcode)
list = ValueList({"txt": 1, "gcode": 2}, selected="gcode")
txt_3 = Text(python_3.gcode)

# ---- group: file_name
panel_33 = Panel("181019")

# ----
list_2 = ValueList({"txt": 1, "gcode": 2}, selected="gcode")
panel_34 = Panel("""G90
M82
M106 S0
M104 S190 T0
M109 S190 T0""")
button = Button()
export_gcode_component = GH_CPython(PATH="C:\Users\yoshioca\Desktop\", File_Name=panel_33, File_Type=list, SKIRT=txt, MSG=txt_2, TF=button)  # -> a, debug; inputs PATH: list, File_Name: list, File_Type: list, SKIRT: list, MSG: list, TF: list
# ---------- export_gcode_component: Python ----------
# Export

def TYPE(num):
    if num == 1:
        type = ".txt"
    elif num == 2:
        type = ".gcode"
    return type


debug = []

path_set = str(PATH)
file_name = str(File_Name)
file_type = TYPE(File_Type)
msg = MSG
skirt = SKIRT



#debug.append(MSG[1])

# Skirt gode
for i in xrange(len(skirt)):
    debug.append(skirt[i])
    debug.append("\n")

debug.append("\n")

# Body gcode
for i in xrange(len(msg)):
    debug.append(msg[i])
    if i < len(msg)-1:
        debug.append("\n")



path_out = path_set + "\\" + file_name + file_type

a = path_out


len = len(debug)

# for i in xrange(len):
#     print(debug[i])


if TF:
    f = open(path_out, "w")
    f.writelines(debug)
    f.close
# ---------- end export_gcode_component ----------

# ---- group: file_name
panel_35 = Panel("181022")

# ----
panel_36 = Panel(button)
panel_37 = Panel(export_gcode_component.a)
panel_38 = Panel(export_gcode_component.debug)
button_2 = Button()
export_gcode_component_2 = GH_CPython(PATH="C:\Users\yoshioca\Desktop\", File_Name=panel_35, File_Type=list_2, Temp=panel_34, MSG=txt_3, TF=button_2)  # -> a, debug; inputs PATH: list, File_Name: list, File_Type: list, Temp: list, MSG: list, TF: list
# ---------- export_gcode_component_2: Python ----------
# Export

def TYPE(num):
    if num == 1:
        type = ".txt"
    elif num == 2:
        type = ".gcode"
    return type


debug = []

path_set = str(PATH)
file_name = str(File_Name)
file_type = TYPE(File_Type)
msg = MSG
temp = Temp




#debug.append(MSG[1])
for i in xrange(len(temp)):
    debug.append(temp[i])
    debug.append("\n")

# Body gcode
for i in xrange(len(msg)):
    debug.append(msg[i])
    if i < len(msg)-1:
        debug.append("\n")



path_out = path_set + "\\" + file_name + file_type

a = path_out


len = len(debug)

# for i in xrange(len):
#     print(debug[i])


if TF:
    f = open(path_out, "w")
    f.writelines(debug)
    f.close
# ---------- end export_gcode_component_2 ----------
panel_39 = Panel(button_2)
panel_40 = Panel(export_gcode_component_2.a)
panel_41 = Panel(export_gcode_component_2.debug)
