# Grasshopper definition Write-gcode-ver3.ghx (Grasshopper 0.9.76)
# plug-ins: Python Interpreter, GH_CPython

# ---- group: W
number_slider = Slider(4, range=0..100)

number_slider_2 = Slider(20, range=0..100)

# ----
number_slider_3 = Slider(150, range=0..1000)

# ---- group: Margin
number_slider_4 = Slider(25, range=1..200)

# ---- group: size
panel = Panel("500")

# ---- group: layer_height
number_slider_5 = Slider(1.5, range=0.1..30)

# ---- group: Margin
number_slider_6 = Slider(25, range=1..200)

# ---- group: size
panel_2 = Panel("500")

# ---- group: layer_count
number_slider_7 = Slider(175, range=1..350)

# ----
rectangle = Rectangle(Plane=PlaneXY(0, 0, 0), XSize="0 to 800", YSize="0 to 800", Radius=0)  # -> Rectangle, Length
crv = Curve(rectangle.Rectangle)

rectangle_2 = Rectangle(Plane=PlaneXY(0, 0, 0), XSize="200 to 600", YSize="200 to 600", Radius=0)  # -> Rectangle, Length
crv_2 = Curve(rectangle_2.Rectangle)

multiplication = Multiplication(A=number_slider_7, B=number_slider_5)
multiplication_2 = Multiplication(A=multiplication, B="2")
neg = Negative(Value=number_slider_4)
division = Division(A="65", B=number_slider)
addition = Addition(A=panel, B=number_slider_4)
division_2 = Division(A=panel_2, B=number_slider_2)
addition_2 = Addition(A=panel_2, B=number_slider_6)
Y = UnitY(Factor=neg)
pt = ConstructPoint(XCoordinate=Slider(40, range=0..1000), YCoordinate=Slider(150, range=0..1000), ZCoordinate=0)
addition_3 = Addition(A=addition, B=number_slider_4)
pt_2 = ConstructPoint(XCoordinate=number_slider_3, YCoordinate=number_slider_3, ZCoordinate=0)
neg_2 = Negative(Value=number_slider_6)

# ---- group: Printing Height
panel_3 = Panel(multiplication_2)

# ----
addition_4 = Addition(A=addition_2, B=number_slider_6)
neg_3 = Negative(Value=addition_3)
Y_2 = UnitY(Factor=addition)
X = UnitX(Factor=number_slider)
neg_4 = Negative(Value=addition_4)
Y_3 = UnitY(Factor=neg_2)
Y_4 = UnitY(Factor=addition_2)
X_2 = UnitX(Factor=number_slider_2)
Y_5 = UnitY(Factor=neg_3)
Y_6 = UnitY(Factor=neg_4)
move = Move(Geometry=pt, Motion=Y)  # -> Geometry, Transform
move_2 = Move(Geometry=pt, Motion=Y_2)  # -> Geometry, Transform
move_3 = Move(Geometry=move_2.Geometry, Motion=X)  # -> Geometry, Transform
move_4 = Move(Geometry=move_3.Geometry, Motion=Y_5)  # -> Geometry, Transform
move_5 = Move(Geometry=move_4.Geometry, Motion=X)  # -> Geometry, Transform
move_6 = Move(Geometry=pt_2, Motion=Y_3)  # -> Geometry, Transform
preview = CustomPreview(Geometry=crv, Shader=ColourSwatch(SwatchColor=RGB(255, 255, 255)))
move_7 = Move(Geometry=pt_2, Motion=Y_4)  # -> Geometry, Transform
move_8 = Move(Geometry=move_7.Geometry, Motion=X_2)  # -> Geometry, Transform
move_9 = Move(Geometry=move_8.Geometry, Motion=Y_6)  # -> Geometry, Transform
move_10 = Move(Geometry=move_9.Geometry, Motion=X_2)  # -> Geometry, Transform
integer_division = IntegerDivision(A=division, B="2")
integer_division_2 = IntegerDivision(A=division_2, B="2")
merge = Merge(Data1=move.Geometry, Data2=move_2.Geometry, Data3=move_3.Geometry, Data4=move_4.Geometry, Data5=move_5.Geometry)
multiplication_3 = Multiplication(A=number_slider, B="2")
multiplication_4 = Multiplication(A=number_slider_2, B="2")
merge_2 = Merge(Data1=move_6.Geometry, Data2=move_7.Geometry, Data3=move_8.Geometry, Data4=move_9.Geometry, Data5=move_10.Geometry)
series = Series(Start=0, Step=multiplication_3, Count=integer_division)
pline = PolyLine(Vertices=merge, Closed=False)
series_2 = Series(Start=0, Step=multiplication_4, Count=integer_division_2)
pline_2 = PolyLine(Vertices=merge_2, Closed=False)
X_3 = UnitX(Factor=series)
X_4 = UnitX(Factor=series_2)
move_11 = Move(Geometry=pline, Motion=X_3)  # -> Geometry, Transform
move_12 = Move(Geometry=pline_2, Motion=X_4)  # -> Geometry, Transform
join = JoinCurves(Curves=move_11.Geometry, Preserve=False)
join_2 = JoinCurves(Curves=move_12.Geometry, Preserve=False)
bbox = BoundingBox(Content=join_2, Plane=PlaneXY(0, 0, 0))  # -> Box, Box_2
area = Area(Geometry=bbox.Box_2)  # -> Area, Centroid
pdecon = Deconstruct(Point=area.Centroid)  # -> XComponent, YComponent, ZComponent
pt_3 = ConstructPoint(XCoordinate=pdecon.XComponent, YCoordinate=pdecon.YComponent, ZCoordinate=0)
rotate = Rotate(Geometry=join_2, Angle="0.5 * pi", Plane=pt_3)  # -> Geometry, Transform
merge_3 = Merge(Data1=join, Data2=join_2, Data3=rotate.Geometry)  # -> flatten(Result)
crv_3 = Curve(rotate.Geometry)
crv_4 = Curve(join_2)
crv_5 = Curve(merge_3)
multiplication_5 = Multiplication(A=number_slider_5, B="2")
series_3 = Series(Start=multiplication_5, Step=multiplication_5, Count=number_slider_7)
series_4 = Series(Start=number_slider_5, Step=multiplication_5, Count=number_slider_7)
viewer = ParamViewer(series_4)
panel_4 = Panel(series_4)
Z = UnitZ(Factor=series_4)
Z_2 = UnitZ(Factor=series_3)
move_13 = Move(Geometry=crv_4, Motion=Z)  # -> Geometry, Transform
move_14 = Move(Geometry=crv_3, Motion=Z_2)  # -> Geometry, Transform
disc = Discontinuity(Curve=join, Level=1)  # -> Points, Parameters
shatter = Shatter(Curve=join, Parameters=disc.Parameters)
disc_2 = Discontinuity(Curve=crv_4, Level=1)  # -> Points, Parameters
shatter_2 = Shatter(Curve=crv_4, Parameters=disc_2.Parameters)
disc_3 = Discontinuity(Curve=crv_3, Level=1)  # -> Points, Parameters
shatter_3 = Shatter(Curve=crv_3, Parameters=disc_3.Parameters)
len = Length(Curve=shatter)
len_2 = Length(Curve=shatter_2)
len_3 = Length(Curve=shatter_3)
pdecon_2 = Deconstruct(Point=disc.Points)  # -> XComponent, YComponent, ZComponent
lng = ListLength(List=len_2)
pdecon_3 = Deconstruct(Point=disc_2.Points)  # -> XComponent, YComponent, ZComponent
pdecon_4 = Deconstruct(Point=disc_3.Points)  # -> XComponent, YComponent, ZComponent
panel_5 = Panel(pdecon_3.ZComponent)
panel_6 = Panel(lng)
lng_2 = ListLength(List=len_3)
lng_3 = ListLength(List=pdecon_2.XComponent)
panel_7 = Panel(lng_2)
lng_4 = ListLength(List=pdecon_3.XComponent)
lng_5 = ListLength(List=pdecon_4.XComponent)
ins = InsertItems(List=len, Item="0", Indices="0", Wrap=True)
ins_2 = InsertItems(List=len_2, Item="0", Indices="0", Wrap=True)
panel_8 = Panel(lng_4)
ins_3 = InsertItems(List=len_3, Item="0", Indices="0", Wrap=True)
panel_9 = Panel(ins_3)
panel_10 = Panel(ins_2)
number_slider_8 = Slider(5, range=0..10)
panel_11 = Panel(ins)
multiplication_6 = Multiplication(A=ins, B=Slider(5, range=0..10))
multiplication_7 = Multiplication(A=ins_2, B=number_slider_8)
multiplication_8 = Multiplication(A=ins_3, B=number_slider_8)
python = PythonScript(x=series_4)  # -> out, a; inputs x: list
# ---------- python: Python ----------
num = x

# print(num)

#len = len(num)
#len = len(x)

print(len)

print("---")

for i in xrange(len):
    print(i)
    
    print(num[i])
# ---------- end python ----------
python_2 = PythonScript(
    layer_count=number_slider_7,
    a_len=lng_4,
    a_x=pdecon_3.XComponent,
    a_y=pdecon_3.YComponent,
    a_z=series_4,
    a_e=multiplication_7,
    b_len=lng_5,
    b_x=pdecon_4.XComponent,
    b_y=pdecon_4.YComponent,
    b_z=series_3,
    b_e=multiplication_8)  # -> out, gcode; inputs layer_count: Int32, a_x: list, a_y: list, a_z: list, a_e: list, b_x: list, b_y: list, b_z: list, b_e: list
# ---------- python_2: Python ----------
gcode = []

z = 0
EA = 0
EB = 0

gcode.append("; Body") #F
gcode.append("G1 Z30" + " F4000") #F

for j in range(layer_count):
    
    # z += layer_height
    print(str(a_z[j]))

    
    for i in range(a_len):
        EA += float(a_e[i])
        delta_EA = float(a_e[i])
        a_test = "G1 X" + str(a_x[i]) + " Y" + str(a_y[i]) + " Z" + str(a_z[j]) + " E" + str(EA) + " ;delta_E " + str(delta_EA)
        gcode.append(a_test)


    EA = 0    
    gcode.append("G92 E0")



    # z += layer_height




    for i in range(b_len):
        EB += float(b_e[i])
        delta_EB = float(b_e[i])
        b_test = "G1 X" + str(b_x[i]) + " Y" + str(b_y[i]) + " Z" + str(b_z[j]) + " E" + str(EB) + " ;delta_E " + str(delta_EB)
        gcode.append(b_test)
    
    EB = 0
    gcode.append("G92 E0")
# ---------- end python_2 ----------
skirt = GH_CPython(layer_height=number_slider_5, a_len=lng_3, a_x=pdecon_2.XComponent, a_y=pdecon_2.ZComponent, a_e=multiplication_6)  # -> gcode; inputs layer_height: list, a_len: list, a_x: list, a_y: list, a_e: list
#   port a_len: [required] - [type = int] - [default = None] Descripe your input here * bullet point. * bullet point
# ---------- skirt: Python ----------
gcode = []

EA = 0

gcode.append("; Skirt")


z = layer_height
gcode.append("G1 Z" + str(z) + " F4000")


for i in xrange(a_len):
    EA += float(a_e[i])
    delta_EA = float(a_e[i])
    a_test = "G1 X" + str(a_x[i]) + " Y" + str(a_y[i]) + " E" + str(EA) + " ;delta_E " + str(delta_EA)
    gcode.append(a_test)

EA = 0    
gcode.append("G92 E0")




len = len(gcode)

for i in xrange(len):
    print(gcode[i])
# ---------- end skirt ----------
python_3 = PythonScript(layer_height=number_slider_5, a_len=lng_3, a_x=pdecon_2.XComponent, a_y=pdecon_2.YComponent, a_e=multiplication_6)  # -> out, gcode; inputs a_x: list, a_y: list, a_e: list
# ---------- python_3: Python ----------
gcode = []

EA = 0

gcode.append("; Skirt") #F


z = layer_height
gcode.append("G1 Z" + str(z) + " F4000") #F

for i in range(a_len):
    EA += float(a_e[i])
    delta_EA = float(a_e[i])
    a_test = "G1 X" + str(a_x[i]) + " Y" + str(a_y[i]) + " E" + str(EA) + " ;delta_E " + str(delta_EA)
    gcode.append(a_test)

EA = 0    
gcode.append("G92 E0")
# ---------- end python_3 ----------
panel_13 = Panel(python.out)
python_4 = PythonScript()  # -> out, a
# ---------- python_4: Python ----------
a = []

a.append("hello")

text = "teeeext"
a.append(text)
# ---------- end python_4 ----------
gh_cpython = GH_CPython()  # -> a
#   port a: indicate your output description here. refers to a new line.
# ---------- gh_cpython: Python ----------
a = []

a.append("hello")

text = "teeeext"
a.append(text)

for i in xrange(2):
    print(a[i])


print("---")

for i in xrange(len(a)):
    print(i)
    print(a[i])

print("---")


print(a)
# ---------- end gh_cpython ----------
panel_14 = Panel(gh_cpython)
panel_15 = Panel(python_4.a)
panel_16 = Panel(python_2.out)
panel_17 = Panel(python_2.gcode)
panel_18 = Panel(python_3.gcode)
panel_19 = Panel(skirt)
txt = Text(python_3.gcode)
txt_2 = Text(python_2.gcode)
list = ValueList({"txt": 1, "gcode": 2}, selected="gcode")

# ---- group: file_name
panel_20 = Panel("181019")

# ----
button = Button()
export_gcode_component = GH_CPython(PATH="C:\Users\yoshioca\Desktop\", File_Name=panel_20, File_Type=list, SKIRT=txt, MSG=txt_2, TF=button)  # -> a, debug; inputs PATH: list, File_Name: list, File_Type: list, SKIRT: list, MSG: list, TF: list
# ---------- export_gcode_component: Python ----------
# Export

def TYPE(num):
    if num == 1:
        type = ".txt"
    elif num == 2:
        type = ".gcode"
    return type


debug = []

path_set = str(PATH)
file_name = str(File_Name)
file_type = TYPE(File_Type)
msg = MSG
skirt = SKIRT



#debug.append(MSG[1])

# Skirt gode
for i in xrange(len(skirt)):
    debug.append(skirt[i])
    debug.append("\n")

debug.append("\n")

# Body gcode
for i in xrange(len(msg)):
    debug.append(msg[i])
    if i < len(msg)-1:
        debug.append("\n")



path_out = path_set + "\\" + file_name + file_type

a = path_out


len = len(debug)

# for i in xrange(len):
#     print(debug[i])


if TF:
    f = open(path_out, "w")
    f.writelines(debug)
    f.close
# ---------- end export_gcode_component ----------
panel_21 = Panel(button)
panel_22 = Panel(export_gcode_component.a)
panel_23 = Panel(export_gcode_component.debug)
